# Grasshopper definition robot_localization.ghx (Grasshopper 1.0.7)

# ----
# Read points from CSV
read_data = Button()
file_path = FilePath("C:\Users\a\repos\compas_mobile_robot_reloc\grasshopper\wcs_frames.csv")
datasource = ValueList({"Total Station": 1, "File": 2}, selected="File")
panel = Panel(file_path)
import_ts_cartesian_coordinates = PythonScript(data_source=datasource, read_data=read_data, filepath_to_read=file_path, prefixes="LP")  # -> out, ids, pts; inputs data_source: Int32, read_data: Boolean, prefixes: list
# ---------- import_ts_cartesian_coordinates: Python ----------
import urllib2
import csv
import os

import rhinoscriptsyntax as rs

from compas_mobile_robot_reloc import MeasurementPoint

if len(prefixes) < 1:
    select_all = True
else:
    select_all = False
    prefixes = [prefix.upper() for prefix in prefixes]


if cache_dir is None:
    cache_dir = os.path.dirname(rs.DocumentPath())

cache_file = os.path.join(cache_dir, 'localization_data_cache.csv')

if data_source == 1:
    file_to_process = cache_file
else:
    file_to_process = filepath_to_read

if read_data and data_source == 1:

    # Fetch file
    data_raw = urllib2.urlopen(total_station_file)

    with open(cache_file, 'w') as f:
        f.write(data_raw.read())

# Read the data from the cached file.
measured_pts = []
if os.path.exists(file_to_process):
    with open(file_to_process, 'r') as fp:
        reader = csv.DictReader(fp, dialect="excel", delimiter=";")

        for pt_data in reader:
            xyz = [pt_data.pop("X"), pt_data.pop("Y"), pt_data.pop("Z")]

            # check if our three values are convertable to float
            try:
                xyz = [float(c) for c in xyz]
            except ValueError:
                continue

            x, y, z = [c * 1000 for c in xyz]

            pt_name = pt_data.pop("NAME")

            measured_pts.append(MeasurementPoint(x, y, z, pt_name, attrs=pt_data))

# raise if no points found
if len(measured_pts) == 0:
    raise Exception("No pts found")

measured_pts.sort(key=lambda pt: (pt.prefix, pt.idx))

if not select_all:
    measured_pts = [pt for pt in measured_pts if pt.prefix in prefixes]

pts = [pt.as_rgpoint() for pt in measured_pts]
ids = [pt.pt_name for pt in measured_pts]
# ---------- end import_ts_cartesian_coordinates ----------
panel_2 = Panel(import_ts_cartesian_coordinates.ids)

# ----
# Read frames from json
path = FilePath("C:\Users\a\repos\compas_mobile_robot_reloc\grasshopper\rcs_frames.json")
panel_3 = Panel(path)
python = GhPythonScript(file_path_to_rcs_json=path)  # -> out, rcs_planes
# ---------- python: Python ----------
import json

import Rhino.Geometry as rg
from compas.utilities import DataDecoder

from compas_mobile_robot_reloc.utils import cgframe_to_rgplane

DataDecoder()

with open(file_path_to_rcs_json, mode="r") as fp:
    frames = json.load(fp, cls=DataDecoder)

rcs_planes = [cgframe_to_rgplane(f) for f in frames]
# ---------- end python ----------
pt = Point(python.rcs_planes)
lng = ListLength(List=pt)
split = SplitList(List=pt, Index=expr("x-1", lng))  # -> ListA, ListB

# ---- group: RCS Test
pt_2 = Point(split.ListB)

# ---- group: RCS
pt_3 = Point(split.ListA)

# ----
pt_4 = Point(import_ts_cartesian_coordinates.pts)
lng_2 = ListLength(List=pt_4)
split_2 = SplitList(List=pt_4, Index=expr("x-1", lng_2))  # -> ListA, ListB

# ---- group: WCS Test
pt_5 = Point(split_2.ListB)

# ---- group: WCS
pt_6 = Point(split_2.ListA)

pt_7 = Point([Point(15402.885, 24560.608, 1046.399), Point(15117.993, 23725.867, 1208.917), Point(15223.168, 22797.331, 2399.654), Point(16199.274, 22003.423, 1362.059), Point(16786.777, 23083.323, 3974.498), Point(17965.302, 23314.847, 4033.842), Point(18982.944, 24283.387, 3544.996), Point(18539.657, 25105.912, 2822.457), Point(17748.109, 25368.456, 2296.253)])

# ---- group: LP RCS
pt_8 = Point([Point(-2306.776611, -271.8359985, -108.4560394), Point(-2306.726318, -1153.883423, 53.65091324), Point(-1908.871948, -2001.105591, 1251.384033), Point(-734.5368042, -2442.07959, 201.8132172), Point(-514.7164917, -1236.922852, 2818.191895), Point(520.430481, -645.9451294, 2879.325684), Point(1171.776001, 591.9587402, 2397.131104), Point(499.1734619, 1232.813843, 1660.648926), Point(-333.9427185, 1232.84729, 1134.185303)])

# ----
# Example requires compas_rrc v1.0.0 as it's
# targeting ABB robot arms and needs to be
# adapted for other setups.
# (All that's needed are some move commands)
# 3-Point Localization
panel_4 = Panel("prism")
set_localization_position = Button()
move_to_first_position_origin = Button()
move_to_second_position_x_axis = Button()
move_to_third_position_y_axis = Button()
set_localization_position_2 = PythonScript(read_position=set_localization_position, tool=panel_4)  # -> out, localization_origin_plane, localization_origin_frame; inputs read_position: Boolean
# ---------- set_localization_position_2: Python ----------
from __future__ import absolute_import
from __future__ import division
from __future__ import print_function

from scriptcontext import sticky

from compas.geometry import Frame
from compas_fab.backends.ros import RosClient
from compas_rrc import AbbClient
from compas_rrc import GetFrame
from compas_rrc import SetAcceleration
from compas_rrc import SetMaxSpeed
from compas_rrc import SetTool
from compas_rrc import SetWorkObject

from compas_mobile_robot_reloc.utils import cgframe_to_rgplane

TIMEOUT = 5 # controller communicaton timeout

if not tool:
    tool = "tool0"
if not wobj:
    wobj = "wobj0"

if not sticky.get("localization_origin"):
    sticky["localization_origin"] = None

if read_position:
    # Create Ros Client
    with RosClient() as ros:
        # Create ABB Client
        abb = AbbClient(ros)
        abb.run(timeout=TIMEOUT)

        # Set prism TCP
        abb.send(SetTool(tool))

        # Unset any active WorkObject
        abb.send(SetWorkObject(wobj))

        # Get location of TCP
        tcp_frame = abb.send_and_wait(GetFrame(), timeout=TIMEOUT)

        sticky["localization_origin"] = tcp_frame

localization_origin_frame = sticky["localization_origin"]
if localization_origin_frame:
    localization_origin_plane = cgframe_to_rgplane(localization_origin_frame)
# ---------- end set_localization_position_2 ----------
distance = Slider(1000, range=100..1000)
localization_positions = PythonScript(
    localization_origin_frame=set_localization_position_2.localization_origin_frame,
    move_to_origin=move_to_first_position_origin,
    move_to_x_pt=move_to_second_position_x_axis,
    move_to_y_pt=move_to_third_position_y_axis,
    distance=distance,
    tool=panel_4)  # -> out, o_pt, x_pt, y_pt
# ---------- localization_positions: Python ----------
from __future__ import absolute_import
from __future__ import division
from __future__ import print_function

from compas.geometry import Frame
from compas.geometry import Translation

from compas_mobile_robot_reloc.utils import cgframe_to_rgplane

if localization_origin_frame is None:
    raise Exception("No origin supplied.")

kwargs = {}

if tool:
    kwargs["tool"] = tool

# classmethod .from_vector needs to be used in compas >= 0.16
Tx = Translation.from_vector([distance, 0, 0])
Ty = Translation.from_vector([0, distance, 0])

o_frame = localization_origin_frame
x_frame = o_frame.transformed(Tx)
y_frame = o_frame.transformed(Ty)

o_pt = cgframe_to_rgplane(o_frame).Origin
x_pt = cgframe_to_rgplane(x_frame).Origin
y_pt = cgframe_to_rgplane(y_frame).Origin

# pick which point to send
if move_to_origin:
    frame = o_frame
    frame_name = "Origin"
elif move_to_x_pt:
    frame = x_frame
    frame_name = "X axis point"
elif move_to_y_pt:
    frame = y_frame
    frame_name = "Y axis point"
else:
    frame = None
    frame_name = None

if frame:
    standalone_move_to_frame(frame, **kwargs)
else:
    print("No motion command sent")
# ---------- end localization_positions ----------
pln = Plane(set_localization_position_2.localization_origin_plane)
panel_5 = Panel(pln)
panel_6 = Panel(localization_positions.out)
merge = Merge(Data1=localization_positions.o_pt, Data2=localization_positions.x_pt, Data3=localization_positions.y_pt)
calculate_transformation = PythonScript(rcs_coords=merge)  # -> out, transformation; inputs rcs_coords: list of Point3d, wcs_coords: list of Point3d
# ---------- calculate_transformation: Python ----------
from compas.geometry import Transformation, Frame

from compas_mobile_robot_reloc import three_pts_localization
from compas_mobile_robot_reloc.xforms import worldxy_to_robot_base_xform
from compas_mobile_robot_reloc.utils import cgtransformation_to_rgtransform
from compas_mobile_robot_reloc.utils import rgpoint_to_cgpoint

if len(rcs_coords) == 0 or len(wcs_coords) == 0:
    raise Exception("No points supplied.")

rcs_coords = [rgpoint_to_cgpoint(pt) for pt in rcs_coords]
wcs_coords = [rgpoint_to_cgpoint(pt) for pt in wcs_coords]

print("Points in RCF")
print("Origin: {}".format(rcs_coords[0]))
print("X: {}".format(rcs_coords[1]))
print("Y: {}".format(rcs_coords[2]))
print("")

print("Points in WCF")
print("Origin: {}".format(wcs_coords[0]))
print("X: {}".format(wcs_coords[1]))
print("Y: {}".format(wcs_coords[2]))
print("")

wcs_robot_base = three_pts_localization(rcs_coords, wcs_coords)

print("RCS X vector in WCS: {}".format(wcs_robot_base.xaxis))
print("RCS Y vector in WCS: {}".format(wcs_robot_base.yaxis))
print("RCS Z vector in WCS: {}".format(wcs_robot_base.zaxis))
print("")

print("Robot base origin in WCS: {}".format(wcs_robot_base.point))

_transformation = worldxy_to_robot_base_xform(wcs_robot_base)

transformation = cgtransformation_to_rgtransform(_transformation)
# ---------- end calculate_transformation ----------
transform = Transform(calculate_transformation.transformation)
panel_7 = Panel(calculate_transformation.out)
matrix = TransformMatrix(calculate_transformation.transformation, Digits=3)

# ----
# Arbitrary Points
# Proxy started when run
# 
# The proxy can be started manually by running `compas_rpc start`.
pt_9 = Point(pt_8)
pt_10 = Point(pt_7)
calculate_transformation_2 = PythonScript(rcs_coords=pt_9, wcs_coords=pt_10, create_plot_files=Toggle(False), maxiter=Slider(300, range=0..500), run=Button())  # -> out, transformation, rg_transform; inputs rcs_coords: list of Point3d, wcs_coords: list of Point3d, create_plot_files: Boolean, maxiter: Int32, run: Boolean
# ---------- calculate_transformation_2: Python ----------
from scriptcontext import sticky

from compas.geometry import Frame
from compas.rpc import Proxy

from compas_mobile_robot_reloc.utils import cgtransformation_to_rgtransform
from compas_mobile_robot_reloc.utils import matrix_to_rgtransform
from compas_mobile_robot_reloc.utils import rgpoint_to_cgpoint
from compas_mobile_robot_reloc.xforms import worldxy_to_robot_base_xform

kwargs = {}

if create_plot_files is not None:
    kwargs["plot_results"] = create_plot_files
if maxiter is not None:
    kwargs["maxiter"] = maxiter

if not sticky.get("apl_result"):
    sticky["apl_result"] = None

if len(rcs_coords) == 0 or len(wcs_coords) == 0:
    raise Exception("No points supplied.")

rcs_coords = [rgpoint_to_cgpoint(pt) for pt in rcs_coords]
wcs_coords = [rgpoint_to_cgpoint(pt) for pt in wcs_coords]

if run and len(rcs_coords) > 0 and len(wcs_coords) > 0:
    with Proxy("compas_mobile_robot_reloc", max_conn_attempts=5) as proxy:
        try:
            result = proxy.arbitrary_pts_localization(
                rcs_coords, wcs_coords, **kwargs
            )
            print(result)
            sticky["apl_result"] = Frame(*result)
        except:
            sticky["apl_result"] = None
            raise

print(sticky["apl_result"])

if sticky["apl_result"] is not None:
    transformation = worldxy_to_robot_base_xform(sticky["apl_result"])
    rg_transform = cgtransformation_to_rgtransform(transformation)
    print(transformation)
# ---------- end calculate_transformation_2 ----------
matrix_2 = TransformMatrix(calculate_transformation_2.rg_transform, Digits=3)
panel_8 = Panel(calculate_transformation_2.out)

transform_2 = Transform(calculate_transformation_2.rg_transform)
